# Grasshopper definition ghgl.gh (Grasshopper 1.0.8)
# plug-ins: RhinoCodePluginGH, ghgl

trigger = Trigger(Interval=-1000, TimerInterval=1000)
trigger_2 = Trigger(Interval=50, TimerInterval=50, Target=py3)  # disabled
toggle = BooleanToggle(True)
image_resource = ImageResource("C:\Users\Matt_S\Documents\pffdtd WORKING DIRECTORY\pffdtd\aspen\output_frames\frame_0078.png")
py3 = Python3Script(x=toggle, y=toggle)  # -> out, a
# ---------- py3: Python ----------
# "reset" is the Boolean input connected to the Boolean Toggle

if 'counter' not in globals():
    counter = 0  # Initialize the counter if it doesn't exist

if y:  # Check if the reset toggle is True
    counter = 0  # Reset the counter

counter += 1  # Increment the counter

a = counter  # Output the counter value
# ---------- end py3 ----------
panel = Panel(py3.a)
py3_2 = Python3Script(x=panel)  # -> out, a
# ---------- py3_2: Python ----------
import os

# Inputs
frame_directory = r"R:\Computer Modeling\pffdtd\ghtest\y50"  # Directory of PNG frames (input as string)

# Validate frame directory
if os.path.isdir(frame_directory):
    # Get sorted list of frame files
    frame_files = sorted(
        [os.path.join(frame_directory, f) for f in os.listdir(frame_directory) if f.endswith(".png")]
    )

    if frame_files:
        # Output the current frame's path
        a = frame_files[int(x)]
else:
    raise ValueError(f"Invalid directory: {frame_directory}")
# ---------- end py3_2 ----------
panel_2 = Panel(py3_2.a)
brep = Brep(<brep referenced from the Rhino model>)
rgb = ColourRGB(Alpha=0, Red=0, Green=0, Blue=0)
rgb_2 = ColourRGB(Alpha=0, Red=0, Green=0, Blue=0)
brep_2 = Brep(<brep referenced from the Rhino model>)
gl_mesh = GLMeshShader(
    M=brep_2,
    Image=panel_2,
    DepthTestingEnabled=True,
    DepthWritingEnabled=True,
    DrawMode=4,
    FragmentShader="""#version 330

uniform sampler2D image; // The texture (PNG with transparency)

in vec2 textureCoordinate; // Texture coordinates

out vec4 fragment_color; // Final output color

void main() {
    fragment_color = texture(image, textureCoordinate);
}""",
    GLShader=(0, 2, 0),
    PreviewSortOrder=5,
    VertexShader="""#version 330

layout(location = 0) in vec3 _meshVertex;
layout(location = 1) in vec3 _meshNormal;
layout(location = 2) in vec2 _meshTextureCoordinate;

uniform mat4 _worldToClip;
out vec3 normal;
out vec2 textureCoordinate;

void main() {
  normal = _meshNormal;
  textureCoordinate = _meshTextureCoordinate;
  gl_Position = _worldToClip * vec4(_meshVertex , 1.0);
}""",
    glLineWidth=3,
    glPointSize=8)  # -> Color, Depth
py3_3 = Python3Script(x=Slider(3, range=1..200))  # -> out, a
# ---------- py3_3: Python ----------
import os

# Inputs
frame_directory = r"R:\Computer Modeling\pffdtd\ghtest\y69"  # Directory of PNG frames (input as string)

# Validate frame directory
if os.path.isdir(frame_directory):
    # Get sorted list of frame files
    frame_files = sorted(
        [os.path.join(frame_directory, f) for f in os.listdir(frame_directory) if f.endswith(".png")]
    )

    if frame_files:
        # Output the current frame's path
        a = frame_files[int(x)]
else:
    raise ValueError(f"Invalid directory: {frame_directory}")
# ---------- end py3_3 ----------
panel_3 = Panel(py3_3.a)
gl_mesh_2 = GLMeshShader(
    M=brep,
    Image=panel_3,
    DepthTestingEnabled=True,
    DepthWritingEnabled=True,
    DrawMode=4,
    FragmentShader="""#version 330

uniform sampler2D image; // The texture (PNG with transparency)

in vec2 textureCoordinate; // Texture coordinates

out vec4 fragment_color; // Final output color

void main() {
    fragment_color = texture(image, textureCoordinate);
}""",
    GLShader=(0, 2, 0),
    PreviewSortOrder=5,
    VertexShader="""#version 330

layout(location = 0) in vec3 _meshVertex;
layout(location = 1) in vec3 _meshNormal;
layout(location = 2) in vec2 _meshTextureCoordinate;

uniform mat4 _worldToClip;
out vec3 normal;
out vec2 textureCoordinate;

void main() {
  normal = _meshNormal;
  textureCoordinate = _meshTextureCoordinate;
  gl_Position = _worldToClip * vec4(_meshVertex , 1.0);
}""",
    glLineWidth=3,
    glPointSize=8)  # -> Color, Depth
preview = CustomPreview(Geometry=brep, Material=rgb)
preview_2 = CustomPreview(Geometry=brep_2, Material=rgb_2)
